# Grasshopper definition 071920242_kmmt_edit.gh (Grasshopper 1.0.8)
# plug-ins: Karamba3D, RhinoCodePluginGH, Pufferfish, goat

number_slider = Slider(6, range=0..100)

# ---- group: issues param
number_slider_2 = Slider(0.56, range=0..1)
# INPUTS
number_slider_3 = Slider(0.5, range=0..1)

# ----
geometry = Geometry(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)
# --IMPORTANT: make sure you set reasonable value ranges for your variables!! ...  and play around to make sure your script does not crash!!!  Otherwise optimiser cannot find properly...
# 
# --see custom objective function under optimisation now that introduces a penalty to situations when utilisation is above 1.
# --clearly identify & annotate all possible input variables
#     -why are so many density variables all set to the same value?
# --test out optimisation for different objectives alone: what if we consider only stiffness? or volume? (subjected to utilisation check)
# 
# --try basic cases and edge cases (e.g. a cone? a cylinder? etc)
# --intuition on where we might strategically add members to improve structural performance?
# --any insights about how performance relates to design?
panel = Panel("to do")
number_slider_4 = Slider(5, range=0..10)
number_slider_5 = Slider(0.2, range=0..1)
number_slider_6 = Slider(0.55, range=0..1)
number_slider_7 = Slider(0.12, range=0..1)
cir = Circle(Plane=PlaneXY(0, 0, 0), Radius=Slider(0.3, range=0..1))
series = Series(Start=0, Step=number_slider_5, Count=number_slider_4)
dom² = ConstructDomain²(DomainU=Domain(0, 1), DomainV=Domain(0, 1))
Z = UnitZ(Factor=series)
subtraction = Subtraction(A=number_slider_4, B=2)
# (0.33,0.69)
panel_2 = Panel("1")
divide = DivideDomain²(Domain=dom², UCount=Slider(22, range=15..55), VCount=Slider(16, range=15..55))
move = Move(Geometry=cir, Motion=Z)  # -> Geometry, Transform
goat = Goat(fitness=num_6, gene=[number_slider_7, number_slider_6])
dedom2 = DeconstructDomain²(Domain=divide)  # -> UComponent, VComponent
license = LicenseKaramba3D()
series_2 = Series(Start=1, Step=1, Count=subtraction)
py3 = Python3Script(
    intervals=dedom2.VComponent,
    ControlPoint1_X="0",
    ControlPoint1_Y="0",
    ControlPoint2_X="0",
    ControlPoint2_Y=number_slider_7,
    ControlPoint3_X="0",
    ControlPoint3_Y=number_slider_6,
    ControlPoint4_X="0",
    ControlPoint4_Y="1")  # -> out, mapped_intervals; inputs intervals: list, ControlPoint1_X: Double, ControlPoint1_Y: Double, ControlPoint2_X: Double, ControlPoint3_X: Double, ControlPoint4_X: Double, ControlPoint4_Y: Double
# ---------- py3: Python ----------
import Rhino.Geometry as rg
import math

def bezier_curve(t, control_points):
    """Calculate the point on a cubic Bezier curve defined by 4 control points at parameter t."""
    n = len(control_points) - 1
    point = rg.Point3d(0, 0, 0)
    for i, p in enumerate(control_points):
        bernstein_poly = (math.factorial(n) / (math.factorial(i) * math.factorial(n - i))) * ((1 - t) ** (n - i)) * (t ** i)
        point += bernstein_poly * p
    return point

def remap_value(value, control_points):
    """Remap a value using a cubic Bezier curve defined by control points."""
    bezier_point = bezier_curve(value, control_points)
    return bezier_point.Y

def generate_bezier_curve(control_points, steps=100):
    """Generate points on the Bezier curve for visualization."""
    curve_points = []
    for i in range(steps + 1):
        t = i / steps
        curve_points.append(bezier_curve(t, control_points))
    return curve_points

# Input control points from Grasshopper sliders
control_points = [
    rg.Point3d(ControlPoint1_X, ControlPoint1_Y, 0), 
    rg.Point3d(ControlPoint2_X, ControlPoint2_Y, 0), 
    rg.Point3d(ControlPoint3_X, ControlPoint3_Y, 0), 
    rg.Point3d(ControlPoint4_X, ControlPoint4_Y, 0)
]

# Debugging: Print control points
print("Control Points:")
for pt in control_points:
    print(pt)


# Ensure interval values are between 0 and 1
intervals = [(max(0, min(1, start)), max(0, min(1, end))) for start, end in intervals]

# Debugging: Print intervals before mapping
print("Intervals Before Mapping:")
for interval in intervals:
    print(interval)

# Map the intervals using the Bezier curve
mapped_intervals = []
for interval in intervals:
    mapped_start = remap_value(interval[0], control_points)
    mapped_end = remap_value(interval[1], control_points)
    mapped_intervals.append(f"{mapped_start:.6f} To {mapped_end:.6f}")

# Debugging: Print mapped intervals
print("Mapped Intervals:")
for interval in mapped_intervals:
    print(interval)
# ---------- end py3 ----------
division = Division(A=number_slider_5, B=2)
genes = GenePool(Decimals=2, Maximum=1, Minimum=0, Value=[0.517632913, 0.3442233889, 0.4739213963])
dom²_2 = ConstructDomain²(DomainU=dedom2.UComponent, DomainV=py3.mapped_intervals)
subtraction_2 = Subtraction(A=division, B=Slider(0.42, range=0..10))
neg = Negative(Value=subtraction_2)
dom = ConstructDomain(DomainStart=neg, DomainEnd=subtraction_2)
slideindom = SlideWithinDomain(Domain=dom, Factor=genes)
item = ListItem(List=move.Geometry, Index=series_2, Wrap=True)
Z_2 = UnitZ(Factor=slideindom)
move_2 = Move(Geometry=item, Motion=Z_2)  # -> Geometry, Transform
genes_2 = GenePool(Decimals=2, Maximum=0.8, Minimum=0.2, Value=[0.3021823864, 0.4915365374, 0.4883168733])
genes_3 = GenePool(Decimals=2, Maximum=0.8, Minimum=0.2, Value=[0.5, 0.5, 0.5])
replace = ReplaceItems(List=move.Geometry, Item=move_2.Geometry, Indices=series_2, Wrap=False)
genes_4 = GenePool(Decimals=2, Maximum=0.8, Minimum=0.2, Value=[0.3021823864, 0.4915365374, 0.4883168733])
panel_3 = Panel("1")
area = Area(Geometry=replace)  # -> Area, Centroid
merge = Merge(Data1=Slider(0.5, range=0..1), Data2=genes_3)
panel_4 = Panel("0.6")
scale = Scale(Geometry=replace, Center=area.Centroid, Factor=merge)  # -> Geometry, Transform
divide_2 = DivideCurve(Curve=scale.Geometry, Count=Slider(16, range=0..40), Kinks=False)  # -> Points, Tangents, Parameters
genes_5 = GenePool(Decimals=2, Maximum=3, Minimum=-3, Value=[0.01, 0.08, -0.59, 0.07])
dispatch = Dispatch(List=divide_2.Points, DispatchPattern=[True, False])  # -> ListA, ListB
vec2pt = Vector2Pt(PointA=dispatch.ListA, PointB=graft(area.Centroid), Unitize=False)  # -> Vector, Length
rev = Reverse(Vector=vec2pt.Vector)
number_slider_8 = Slider(0.19, range=0..1)
amp = Amplitude(Vector=simplify(rev), Amplitude=simplify(graft(Slider(0, range=0..100))))
move_3 = Move(Geometry=dispatch.ListA, Motion=amp)  # -> Geometry, Transform
item_2 = ListItem(List=area.Centroid, Index=0, Wrap=True)  # -> Item1, Item
neg_2 = Negative(Value=number_slider_8)
weave = Weave(Pattern=[0, 1], Stream0=move_3.Geometry, Stream1=dispatch.ListB, NullGaps=False)
dom_2 = ConstructDomain(DomainStart=number_slider_8, DomainEnd=neg_2)
intcrv = Interpolate(Vertices=weave, Degree=3, Periodic=True, KnotStyle=1)  # -> flatten(Curve), Length, Domain
item_3 = ListItem(List=reverse(intcrv.Curve), Index=0, Wrap=True)
boundary = BoundarySurfaces(Edges=item_3)
loft = Loft(Curves=intcrv.Curve, Options={Adjust=False, Closed=False, LoftEnds=0, LoftSimp=0, LoftType=0, Rebuild=10, Refit=0.01})
rectangle = Rectangle(Plane=item_2.Item1, XSize=dom_2, YSize=dom_2, Radius=0)  # -> Rectangle, Length
number_slider_9 = Slider(0.2, range=0..10)
transpose = TransposeSurface(Surface=loft)  # -> Surface, UComponent, VComponent
swapsrfdir = SwapSurfaceDirections(Surface=transpose.Surface, ReverseU=Toggle(True), ReverseV=Toggle(True), SwapUV=Toggle(False))
subsrf = Isotrim(Surface=reparameterize(swapsrfdir), Domain=dom²_2)
crv = Curve(subsrf)
debrep = DeconstructBrep(Brep=subsrf)  # -> Faces, Edges, Vertices
preview = CustomPreview(
    Geometry=crv,
    Material={diffuse=RGB(221, 160, 221), emission=RGB(66, 48, 66), shine=0.5, specular=RGB(255, 255, 255), transparency=0})

# ---- group: bad practice: ordering can get messed up
crv_2 = Curve(debrep.Edges)
panel_5 = Panel("""0
2""")
item_4 = ListItem(List=crv_2, Index=panel_5, Wrap=True)
item_5 = ListItem(List=crv_2, Index="1", Wrap=True)  # -> flatten(Item)
item_6 = ListItem(List=item_4, Index=0, Wrap=True)  # -> flatten(Item), flatten(Item1)
join = JoinCurves(Curves=item_5, Preserve=False)
join_2 = JoinCurves(Curves=item_6.Item1, Preserve=False)
join_3 = JoinCurves(Curves=item_6.Item, Preserve=False)
curvepoint = PointOnCurve(join, parameter=0)
crv_3 = Curve([join_3, join_2])
item_7 = ListItem(List=crv_3, Index=0, Wrap=True)
curvepoint_2 = PointOnCurve(item_7, parameter=0)
alicrvseams = AlignCurveSeams(Curves=reparameterize(crv_3), Guide=curvepoint_2, Seam="0", Snap=False, Iterative=False)  # -> Aligned, Points, R
cullpt = CullDuplicates(Points=alicrvseams.Points, Tolerance=0.01, CullMode=1)  # -> Points, Indices, Valence
item_8 = ListItem(List=crv_3, Index=cullpt.Indices, Wrap=True)

# ---- group: ensure sorted
crv_4 = Curve(item_8)
curvepoint_3 = PointOnCurve(crv_4, parameter=0.5)
pdecon = Deconstruct(Point=curvepoint_3)  # -> XComponent, YComponent, ZComponent
sort = SortList(Keys=pdecon.ZComponent, ValuesA=crv_4)  # -> Keys, reverse(ValuesA)
crv_5 = Curve(sort.ValuesA)

# ----
item_9 = ListItem(List=crv_5, Index=0, Wrap=True)
crv_cp = CurveClosestPoint(Point=curvepoint, Curve=item_9)  # -> Point, Parameter, Distance
sort_2 = SortList(Keys=crv_cp.Parameter, ValuesA=join)  # -> Keys, ValuesA
ccx = CurveCurve(CurveA=graft(crv_5), CurveB=sort_2.ValuesA)  # -> simplify(Points), ParamsA, ParamsB
pshift = ShiftPaths(Data=ccx.Points, Offset=-1)  # -> simplify(Data)
tstat = TreeStatistics(Tree=pshift)  # -> Paths, Length, Count
dispatch_2 = Dispatch(List=tstat.Paths, DispatchPattern=[True, False])  # -> ListA, ListB
branch = TreeBranch(Tree=pshift, Path=dispatch_2.ListB, MaintainPaths=True)
branch_2 = TreeBranch(Tree=pshift, Path=dispatch_2.ListA, MaintainPaths=True)

# ---- group: Mesh Breps (Karamba3D)
mesh_breps = MeshBrepsKaramba3D(
    Brep=swapsrfdir,
    MeshResolution=Slider(0.1, range=0..0.1),
    EdgeRefinementFactor=0.67,
    PointReduction=False,
    SmoothingStepSize=0,
    SmoothingIterations=5)  # -> Mesh, Info

# ----
# KPa to kN/cm²
panel_6 = Panel("0.0001")
multiplication = Multiplication(A=Slider(166, range=0..1000), B=panel_6)

number_slider_10 = Slider(2.9, range=0..10)
panel_7 = Panel("2.7---3.6")

dispatch_3 = Dispatch(List=branch_2, DispatchPattern=[True, False])  # -> ListA, ListB
dispatch_4 = Dispatch(List=branch, DispatchPattern=[True, False])  # -> ListA, ListB
mesh = Mesh(swapsrfdir)
branch_3 = TreeBranch(Tree=simplify(weave), Path="0", MaintainPaths=True)
panel_8 = Panel("5")
matprops = MaterialPropertiesKaramba3D(
    FamilyOfMaterial="Steel",
    Name="S235",
    YoungsModulus_kN_cm²=number_slider_10,
    InPlaneShearModulus_kN_cm²=expr("x/2", number_slider_10),
    TransverseShearModulus_kN_cm²=expr("x/2", number_slider_10),
    SpecificWeight_kN_m³=Slider(19.6, range=0..100),
    CoefficientOfThermalExpansion_1=1.2e-05,
    TensileStrength_kN_cm²=Slider(0.01, range=0..0.01),
    CompressiveStrength_kN_cm²=expr("x*-1", multiplication),
    StrengthHypothesis="MISES",
    mode="Isotrop")

# ---- group: Mesh Breps (Karamba3D)
mesh_breps_2 = MeshBrepsKaramba3D(
    Brep=boundary,
    MeshResolution=Slider(0.6, range=0..10),
    EdgeRefinementFactor=0.67,
    PointReduction=False,
    SmoothingStepSize=0,
    SmoothingIterations=5)  # -> Mesh, Info

# ----
crosec = CrossSectionKaramba3D(FamilyNameOfCrossSection="DefaultCroSec", Material=matprops, Height_cm=1, mode="Shell - Const")
mesh_2 = Mesh(boundary)
Z_3 = UnitZ(Factor=Slider(3, range=0..10))
number_slider_11 = Slider(0, range=0..100)
number_slider_12 = Slider(10, range=0..10)
neg_3 = Negative(Value=Z_3)
merge_2 = Merge(Data1=dispatch_3.ListB, Data2=dispatch_4.ListA)
branch_4 = TreeBranch(Tree=merge_2, Path=Slider(15, range=0..100), MaintainPaths=True)

# ---- group: Loads (Karamba3D)
loads = LoadsKaramba3D(Vector=Vector(0, 0, -1), LCase="LC0", mode="Gravity")

# ----
pline = PolyLine(Vertices=merge_2, Closed=True)
tstat_2 = TreeStatistics(Tree=pline)  # -> Paths, Length, Count
dispatch_5 = Dispatch(List=tstat_2.Paths, DispatchPattern=[True, False])  # -> ListA, ListB
branch_5 = TreeBranch(Tree=pline, Path=dispatch_5.ListA, MaintainPaths=True)
tstat_3 = TreeStatistics(Tree=branch_5)  # -> Paths, Length, Count
dispatch_6 = Dispatch(List=tstat_3.Paths, DispatchPattern=[True, False])  # -> ListA, ListB
branch_6 = TreeBranch(Tree=branch_5, Path=dispatch_6.ListA, MaintainPaths=True)
branch_7 = TreeBranch(Tree=branch_5, Path=dispatch_6.ListB, MaintainPaths=True)

# ---- group: Loads (Karamba3D)
loads_2 = LoadsKaramba3D(
    Vector=neg_3,
    Mesh=mesh_2,
    ElementIdentifiers=item_3,
    LCase="LC0",
    mode="MeshLoad -Const.",
    menu=[buttons(off, off, on), buttons(on, on)])

# ----
surfelem = CreateSurfaceElementKaramba3D(Mesh=mesh, Identifier="shell", CrossSection=crosec, LimitDistance_m=0.005, mode="MeshToShell")  # -> Element, Points, Info
pdecon_2 = Deconstruct(Point=surfelem.Points)  # -> XComponent, YComponent, ZComponent
smaller = SmallerThan(FirstNumber=pdecon_2.ZComponent, SecondNumber=Slider(1, range=0..1))  # -> SmallerThan, OrEqualTo
cull = CullPattern(List=surfelem.Points, CullPattern=smaller.SmallerThan)
cps = ClosestPoints(Point=branch_3, Cloud=cull, Count=3)  # -> ClosestPoint, CPIndex, Distance
item_10 = ListItem(List=cps.ClosestPoint, Index=0, Wrap=True)  # -> flatten(Item)
supp = SupportKaramba3D(PosInd=item_10, menu=[buttons(on, on, on, off, off, off)])

tree_statistics = TreeStatistics(Tree=merge_2)  # -> Paths, Length, Count
dispatch_7 = Dispatch(List=tree_statistics.Paths, DispatchPattern=[True, False])  # -> ListA, ListB
split_tree = SplitTree(Data=merge_2, Masks=flatten(dispatch_7.ListA))  # -> Positive, Negative
shift_list = ShiftList(List=split_tree.Negative, Shift=Slider(1, range=0..5), Wrap=True)
merge_3 = Merge(Data1=split_tree.Positive, Data2=simplify(shift_list))
flip_matrix = FlipMatrix(Data=merge_2)
flip_matrix_2 = FlipMatrix(Data=merge_3)
polyline = PolyLine(Vertices=flip_matrix_2, Closed=False)
polyline_2 = PolyLine(Vertices=flip_matrix, Closed=False)
curve = Curve(polyline_2)
curve_2 = Curve(polyline)

load = LoadKaramba3D(flatten([loads, loads_2]))
range = Range(Domain=Domain(0, 1), Steps=10)
gradient = Gradient(
    LowerLimit=0,
    UpperLimit=1,
    Parameter=range,
    stops=[0: RGB(234, 38, 0), 0.25: RGB(234, 126, 0), 0.5: RGB(254, 244, 84), 0.75: RGB(173, 203, 249), 1: RGB(75, 107, 169)])
colour = Colour(reverse(gradient))

# ---- group: Assemble Model (Karamba3D)
assemble = AssembleModelKaramba3D(Elem=surfelem.Element, Support=supp, Load=load, LimitDistance_m=0.005, CrossSection=crosec, Material=matprops)  # -> Model, Info, Mass_kg, CentreOfGravity, LoadCaseNames

# ---- group: Analyse (Karamba3D)
analyse = AnalyseKaramba3D(Model=assemble.Model)  # -> AnalysedModel, MaximumDisplacement_cm, ResultingForce_kN, ChangeOfElasticEnergy_kNm

# ----
num = Number(analyse.MaximumDisplacement_cm)

# ---- group: Model View (Karamba3D)
modelview = ModelViewKaramba3D(Model=analyse.AnalysedModel, Colours=colour)  # -> Model, DeformedMesh, DeformedAxes, DeformedModel, MaximumDeformation

# ----
utilization = UtilizationOfElementsKaramba3D(AnalysedModel=analyse.AnalysedModel, mode="Shells")  # -> Model, flatten(Utilization), LoadCaseIndex

# ---- group: Shell View (Karamba3D)
shellview = ShellViewKaramba3D(Model=modelview.Model, IndexOfLayer=0)  # -> Model, MeshesOfRenderedShells, LegendColours, LegendTags

# ----
bnd = Bounds(Numbers=utilization.Utilization)
panel_9 = Panel(bnd)
legend = Legend(Colour=shellview.LegendColours, Tags=shellview.LegendTags, LegendType=1)

# ----
# km/h
number_slider_13 = Slider(10.8, range=0..100)

# ----
# convert wind speed to KN
expression = Expression(x=number_slider_13, Expression="0.5*1.225*(10.8/3.6)²*-1")
Y = UnitY(Factor=expression)

panel_10 = Panel("0.1")
number_slider_14 = Slider(1, range=0..1)
neg_4 = Negative(Value=Slider(3, range=0..100))
number_slider_15 = Slider(0.01, range=0..0.01)
Z_4 = UnitZ(Factor=neg_4)
crosec_2 = CrossSectionKaramba3D(FamilyNameOfCrossSection="DefaultCroSec", Diameter_cm="1.6", WallThickness_cm=expr("x/2", "1.6"), mode="Circular Hollow")

# ---- group: Loads (Karamba3D)
loads_3 = LoadsKaramba3D(Vector=Vector(0, 0, -1), LCase="LC0", mode="Gravity")

# ----
# 0.6->1.8
subtraction_3 = Subtraction(A="1.8", B="0.6")
dom_3 = ConstructDomain(DomainStart="0.6", DomainEnd="1.8")
division_2 = Division(A=subtraction_3, B=0.1)
swatch = ColourSwatch(SwatchColor=RGB(89, 165, 236))
range_2 = Range(Domain=dom_3, Steps=division_2)
concat = Concatenate(FragmentA="D->", FragmentB=range_2)
material = CreateMaterial(Diffuse=swatch, Specular=swatch, Emission=RGB(0, 0, 0), Transparency=0, Shine=0)
crosec_3 = CrossSectionKaramba3D(
    FamilyNameOfCrossSection="DefaultCroSec",
    NameOfCrossSection=concat,
    Material=matprops,
    Diameter_cm=range_2,
    WallThickness_cm=expr("x/2", range_2),
    mode="Circular Hollow")
merge_4 = Merge(Data1="GG_def", Data2="Lattice_def", Data3="Mass_Structure")  # -> flatten(Result)
txt = Text(merge_4)

num_2 = Number(Slider(1000, range=0..1000000))

disc = Discontinuity(Curve=branch_7, Level=1)  # -> Points, Parameters
pcen = PolygonCenter(Polyline=branch_6)  # -> CenterV, CenterE, CenterA
flip = FlipMatrix(Data=disc.Points)
pt = Point(pcen.CenterE)
weave_2 = Weave(Pattern=[0, 1], Stream0=flatten(pt), Stream1=flip, NullGaps=False)
pline_2 = PolyLine(Vertices=weave_2, Closed=False)  # -> reparameterize(Polyline)
explode = Explode(Curve=pline_2, Recursive=True)  # -> Segments, Vertices
curvepoint_4 = PointOnCurve(explode.Segments, parameter=0.5)
crv_cp_2 = CurveClosestPoint(Point=simplify(curvepoint_4), Curve=simplify(pline_2))  # -> Point, Parameter, Distance
shatter = Shatter(Curve=pline_2, Parameters=crv_cp_2.Parameter)
dispatch_8 = Dispatch(List=shatter, DispatchPattern=[False, True])  # -> ListA, ListB

disc_2 = Discontinuity(Curve=branch_6, Level=1)  # -> Points, Parameters
pcen_2 = PolygonCenter(Polyline=branch_7)  # -> CenterV, CenterE, CenterA
flip_2 = FlipMatrix(Data=disc_2.Points)
pt_2 = Point(pcen_2.CenterE)
weave_3 = Weave(Pattern=[1, 0], Stream0=flatten(pt_2), Stream1=flip_2, NullGaps=False)
pline_3 = PolyLine(Vertices=weave_3, Closed=False)  # -> reparameterize(Polyline)
explode_2 = Explode(Curve=pline_3, Recursive=True)  # -> Segments, Vertices
weave_4 = Weave(Pattern=[0, 1], Stream0=explode_2.Vertices, Stream1=curvepoint_4, NullGaps=False)
pline_4 = PolyLine(Vertices=weave_4, Closed=False)
explode_3 = Explode(Curve=pline_4, Recursive=True)  # -> Segments, Vertices
panel_11 = Panel("""1
0
0
1""")
dispatch_9 = Dispatch(List=explode_3.Segments, DispatchPattern=panel_11)  # -> ListA, ListB
weave_5 = Weave(Pattern=[0, 1], Stream0=dispatch_8.ListB, Stream1=dispatch_9.ListB, NullGaps=False)
join_4 = JoinCurves(Curves=weave_5, Preserve=False)

weave_6 = Weave(Pattern=[0, 1], Stream0=dispatch_9.ListA, Stream1=dispatch_8.ListA, NullGaps=False)
join_5 = JoinCurves(Curves=weave_6, Preserve=False)

merge_5 = Merge(Data1=flatten(curve), Data2=flatten(curve_2), Data3=flatten(join_5), Data4=flatten(join_4))
explode_4 = Explode(Curve=merge_5, Recursive=True)  # -> flatten(Segments), Vertices
pdecon_3 = Deconstruct(Point=flatten(explode_4.Vertices))  # -> XComponent, YComponent, ZComponent
cset = CreateSet(List=pdecon_3.ZComponent)  # -> Set, Map
panel_12 = Panel(pdecon_3.ZComponent)
sort_3 = SortList(Keys=cset.Set)  # -> Keys, ValuesA
similar = Similarity(FirstNumber=pdecon_3.ZComponent, SecondNumber="0", Threshold=0.1)  # -> Similarity, AbsoluteDifference
item_11 = ListItem(List=sort_3.Keys, Index=0, Wrap=True)
rdlines = RemoveDuplicateLinesKaramba3D(Line=explode_4.Segments, LimitDistance=0.005)  # -> OutLine, Info, Indexes
smaller_2 = SmallerThan(FirstNumber=pdecon_3.ZComponent, SecondNumber=item_11)  # -> SmallerThan, OrEqualTo
cull_2 = CullPattern(List=flatten(explode_4.Vertices), CullPattern=smaller_2.OrEqualTo)
cset_2 = CreateSet(List=cull_2)  # -> Set, Map
supp_2 = SupportKaramba3D(PosInd=cset_2.Set, menu=[buttons(on, on, on, on, on, on)])
fillet = FilletDistance(Curve=merge_5, Distance=number_slider_15)  # disabled
lineelem = CreateLinearElementKaramba3D(
    Line=rdlines.OutLine,
    CrossSection=crosec_2,
    LimitDistance_m=0.005,
    BucklingLengthY_m=-1,
    BucklingLengthZ_m=-1,
    BucklingLengthLT_m=-1,
    Bending=True,
    ToPolylineMaxAngle=0.03,
    ToPolylineTolerance=0.01,
    ToPolylineMaxEdgeLength=0.25,
    New=True,
    Remove=True,
    mode="LineToBeam")  # -> Element, Points, Info

Y_2 = UnitY(Factor=1)
pt_3 = Point(lineelem.Points)
line = LineSDL(Start=pt_3, Direction=Y_2, Length=1)
srf = Surface(swapsrfdir)
bcx = BrepCurve(Brep=srf, Curve=line)  # -> Curves, Points
lng = ListLength(List=bcx.Points)
smaller_3 = SmallerThan(FirstNumber=lng, SecondNumber=2)  # -> flatten(SmallerThan), OrEqualTo
cull_3 = CullPattern(List=pt_3, CullPattern=smaller_3.SmallerThan)
srf_cp = SurfaceClosestPoint(Point=cull_3, Surface=srf)  # -> Point, UVPoint, Distance
expression_2 = Expression(x=srf_cp.Distance, Expression="if (x ≈ 0, true, false)")
cull_4 = CullPattern(List=cull_3, CullPattern=expression_2)

pdecon_4 = Deconstruct(Point=lineelem.Points)  # -> XComponent, YComponent, ZComponent
cset_3 = CreateSet(List=pdecon_4.ZComponent)  # -> Set, Map
sort_4 = SortList(Keys=cset_3.Set)  # -> reverse(Keys), ValuesA
item_12 = ListItem(List=sort_4.Keys, Index=0, Wrap=True)
larger = LargerThan(FirstNumber=pdecon_4.ZComponent, SecondNumber=item_12)  # -> LargerThan, OrEqualTo
cull_5 = CullPattern(List=lineelem.Points, CullPattern=larger.OrEqualTo)
cset_4 = CreateSet(List=cull_5)  # -> Set, Map

# ---- group: Loads (Karamba3D)
# Vertical loads
loads_4 = LoadsKaramba3D(ForceVector=Z_4, Local=False, PosInd=cset_4.Set, LCase="LC0", mode="Point")  # disabled

# Wind load
loads_5 = LoadsKaramba3D(ForceVector=Y, Local=False, PosInd=cull_4, LCase="LC0", mode="Point")  # disabled

# ----
explode_5 = Explode(Curve=fillet, Recursive=True)  # -> Segments, Vertices
pline_5 = PolyLine(Vertices=explode_5.Vertices, Closed=False)
load_2 = LoadKaramba3D(flatten([loads_4, loads_3, loads_5]))
fillet_2 = FilletDistance(Curve=pline_5, Distance=number_slider_15)  # -> flatten(Curve)
pipe = Pipe(Curve=fillet_2, Radius="0.005", Caps=0)  # -> flatten(Pipe)

# ---- group: Assemble Model (Karamba3D)
assemble_2 = AssembleModelKaramba3D(Elem=lineelem.Element, Support=supp_2, Load=load_2, LimitDistance_m=0.005, Material=matprops)  # -> Model, Info, Mass_kg, CentreOfGravity, LoadCaseNames

# ----
preview_2 = CustomPreview(Geometry=pipe, Material=material)

# ---- group: Optimize Cross Section (Karamba3D)
opticrosec = OptimizeCrossSectionKaramba3D(
    Model=assemble_2.Model,
    CrossSections=crosec_3,
    MaximumUtilization=1,
    MaximumVirtualWork_kNcm=0.01,
    NumberOfUtilizationIterations=5,
    NumberOfDisplacementIterations=5,
    NumberOfDisplacementIncrementsPerIteration=2,
    DisplacementTolerance=0.01,
    NumberOfSamplePoints=3,
    ElasticDesign=True,
    GammaM0=1,
    GammaM1=1.1,
    SwayFrame=True)  # -> OptimizedModel, Info, Mass_kg, MaximumDisplacement_cm, ElasticEnergyChange_kNm, MaximumUtilizationViewInsufficientCrossSections, MaximumDisplacementViewLimitCrossSections

# ---- group: Disassemble Model (Karamba3D)
disassemble = DisassembleModelKaramba3D(Model=opticrosec.OptimizedModel)  # -> Model, Point, Beam, Shell, Support, Load, Line, Mesh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

# ----
disassemble_2 = DisassembleElementKaramba3D(Element=disassemble.Beam)  # -> Element, ElementIdentifier, AxisOfElement, CrossSection, Joint, Material, LocalCoordinateSystem, ElementIsActive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
disassemble_3 = DisassembleCrossSectionKaramba3D(CroSec=disassemble_2.CrossSection)  # -> CrossSection, FamilyNameOfCrossSection, TypeNameOfCrossSection, ElemIdentifiers, Colour, Material, LocalEccentricity_cm, Heights_cm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
split = TextSplit(Text=disassemble_3.TypeNameOfCrossSection, Separators="D->")
item_13 = ListItem(List=reverse(split), Index=0, Wrap=True)  # -> flatten(Item)
panel_13 = Panel(item_13)

utilization_2 = UtilizationOfElementsKaramba3D(
    AnalysedModel=opticrosec.OptimizedModel,
    NumberOfSamplePoints=3,
    ElasticDesign=True,
    GammaM0=1,
    GammaM1=1.1,
    SwayFrame=True,
    WithDetails=False,
    mode="Beams")  # -> Model, flatten(Utilization), SigMax_kN_cm², SigMin_kN_cm², TauMax_kN_cm², UtilN, UtilVy, UtilVz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
panel_14 = Panel(assemble_2.Mass_kg)
panel_15 = Panel(opticrosec.Mass_kg)
bnd_2 = Bounds(Numbers=utilization_2.Utilization)
panel_16 = Panel(bnd_2)
dedomain = DeconstructDomain(Domain=bnd_2)  # -> Start, End
merge_6 = Merge(Data1=analyse.MaximumDisplacement_cm, Data2=opticrosec.MaximumDisplacement_cm, Data3=opticrosec.Mass_kg)  # -> flatten(Result)
num_3 = Number(dedomain.End)

num_4 = Number(opticrosec.Mass_kg)
num_5 = Number(num_3)
py3_2 = Python3Script(fval=num_4, util_max=num_5, p=num_2)  # -> out, fval_1
# ---------- py3_2: Python ----------
"""Grasshopper Script"""

try:
    fval_1 = fval + abs(max(0., util_max - 1.0)) * p
except:
    fval_1 = p
# ---------- end py3_2 ----------
num_6 = Number(py3_2.fval_1)
panel_17 = Panel(num_6)

util_max = Panel(num_5)
volume = Panel(num_4)

# ---- group: Model View (Karamba3D)
modelview_2 = ModelViewKaramba3D(Model=opticrosec.OptimizedModel)  # -> Model, DeformedMesh, DeformedAxes, DeformedModel, MaximumDeformation

# ----
num_7 = Number(merge_6)

# ---- group: Beam View (Karamba3D)
beamview = BeamViewKaramba3D(Model=modelview_2.Model)  # -> Model, MeshesOfRenderedBeams, DeformedBeamAxes, LegendColours, LegendTags

# ----
panel_18 = Panel(merge_6)
