# Grasshopper definition 072224_2.gh (Grasshopper 1.0.8)
# plug-ins: Karamba3D, Pufferfish, goat

number_slider = Slider(0.3, range=0..10)

# ----
# Gap
number_slider_2 = Slider(0.05, range=0..1)

# ----
# Gap
number_slider_3 = Slider(0.05, range=0..1)

number_slider_4 = Slider(0.2, range=0..0.2)
number_slider_5 = Slider(0, range=0..0.2)
number_slider_6 = Slider(0.047, range=0..0.2)
number_slider_7 = Slider(0.12, range=0..0.2)
panel = Panel("0")
series = Series(Start=0, Step=number_slider, Count="4")
subtraction = Subtraction(A=number_slider, B=number_slider_3)
merge = Merge(Data1=number_slider_5, Data2=number_slider_6, Data3=number_slider_7, Data4=number_slider_4)
expression = Expression(x=number_slider, y=number_slider_2, Expression="(x/2)-y")
subtraction_2 = Subtraction(A="4", B=2)
pt = ConstructPoint(XCoordinate=merge, YCoordinate=0, ZCoordinate=series)
series_2 = Series(Start=1, Step=1, Count=subtraction_2)
dom = ConstructDomain(DomainStart=expr("x*-1", expression), DomainEnd=subtraction)
dom_2 = ConstructDomain(DomainStart=expr("x*-1", subtraction), DomainEnd=expression)
item = ListItem(List=pt, Index=series_2, Wrap=True)
number_slider_8 = Slider(0.711, range=0..1)
number_slider_9 = Slider(0.002, range=0..1)
pdecon = Deconstruct(Point=item)  # -> XComponent, YComponent, ZComponent
slideindom = SlideWithinDomain(Domain=dom, Factor=number_slider_9)
slideindom_2 = SlideWithinDomain(Domain=dom_2, Factor=number_slider_8)
merge_2 = Merge(Data1=slideindom_2, Data2=slideindom)

item_2 = ListItem(List=reverse(pt), Index=0, Wrap=True)
item_3 = ListItem(List=pt, Index=0, Wrap=True)
Z = UnitZ(Factor="0.15")
Z_2 = UnitZ(Factor="0.15")
move = Move(Geometry=item_3, Motion=expr("x*-1", Z))  # -> Geometry, Transform
move_2 = Move(Geometry=item_2, Motion=Z_2)  # -> Geometry, Transform
merge_3 = Merge(Data1=move.Geometry, Data2=move_2.Geometry)

addition = Addition(A=pdecon.ZComponent, B=merge_2)
pt_2 = ConstructPoint(XCoordinate=pdecon.XComponent, YCoordinate=pdecon.YComponent, ZCoordinate=addition)
replace = ReplaceItems(List=pt, Item=pt_2, Indices=series_2, Wrap=False)
lng = ListLength(List=replace)
merge_4 = Merge(Data1="0", Data2=lng)  # -> flatten(Result)
ins = InsertItems(List=replace, Item=merge_3, Indices=merge_4, Wrap=True)
number_slider_10 = Slider(0.63, range=0..1)
nurbs = NurbsCurve(Vertices=ins, Degree=3, Periodic=False)  # -> Curve, Length, Domain
mirror = Mirror(Geometry=nurbs.Curve, Plane=PlaneYZ(0, 0, 0))  # -> Geometry, Transform
X = UnitX(Factor=number_slider_10)
move_3 = Move(Geometry=mirror.Geometry, Motion=X)  # -> Geometry, Transform
Y = UnitY(Factor=1)
end = EndPoints(Curve=nurbs.Curve)  # -> Start, End
end_2 = EndPoints(Curve=move_3.Geometry)  # -> Start, End
neg = Negative(Value=Y)
arc = ArcSED(Start=end.End, End=end_2.End, Direction=Y)  # -> Arc, Plane, Radius
arc_2 = ArcSED(Start=end.Start, End=end_2.Start, Direction=neg)  # -> Arc, Plane, Radius
license = LicenseKaramba3D()
swp2 = Sweep2(Rail1=nurbs.Curve, Rail2=move_3.Geometry, Sections=[arc_2.Arc, arc.Arc], SameHeight=True)

subtraction_3 = Subtraction(A=number_slider_10, B=number_slider_4)
cluster = Cluster(G=swp2, F=subtraction_3)

bbox = BoundingBox(Content=swp2, Plane=PlaneXY(0, 0, 0))  # -> Box, Box_2
wires = BrepWireframe(Brep=bbox.Box, Density=-1)
len = Length(Curve=wires)
cset = CreateSet(List=len)  # -> Set, Map
mesh_breps = MeshBrepsKaramba3D(
    Brep=swp2,
    MeshResolution=Slider(0.06, range=0..1),
    EdgeRefinementFactor=0.67,
    PointReduction=False,
    SmoothingStepSize=0,
    SmoothingIterations=5)  # -> Mesh, Info
panel_2 = Panel(cset.Set)

number_slider_11 = Slider(2.9, range=0..10)
panel_3 = Panel("2.7---3.6")

# ----
# KPa to kN/cm²
panel_4 = Panel("0.0001")
multiplication = Multiplication(A=Slider(166, range=0..1000), B=panel_4)

number_slider_12 = Slider(6, range=0..15)
divide = DivideCurve(Curve=arc_2.Arc, Count=Slider(20, range=0..100), Kinks=False)  # -> Points, Tangents, Parameters
matprops = MaterialPropertiesKaramba3D(
    FamilyOfMaterial="Steel",
    Name="S235",
    YoungsModulus_kN_cm²=number_slider_11,
    InPlaneShearModulus_kN_cm²=expr("x/2", number_slider_11),
    TransverseShearModulus_kN_cm²=expr("x/2", number_slider_11),
    SpecificWeight_kN_m³=Slider(19.6, range=0..100),
    CoefficientOfThermalExpansion_1=1.2e-05,
    TensileStrength_kN_cm²=Slider(0.01, range=0..0.01),
    CompressiveStrength_kN_cm²=expr("x*-1", multiplication),
    StrengthHypothesis="MISES",
    mode="Isotrop")
crosec = CrossSectionKaramba3D(FamilyNameOfCrossSection="DefaultCroSec", Material=matprops, Height_cm=1, mode="Shell - Const")
loads = LoadsKaramba3D(Vector=Vector(0, 0, -1), LCase="LC0", mode="Gravity")
surfelem = CreateSurfaceElementKaramba3D(Mesh=mesh_breps.Mesh, Identifier="shell", CrossSection=crosec, LimitDistance_m=0.005, mode="MeshToShell")  # -> Element, Points, Info
pdecon_2 = Deconstruct(Point=surfelem.Points)  # -> XComponent, YComponent, ZComponent
sort = SortList(Keys=pdecon_2.ZComponent)  # -> Keys, ValuesA
item_4 = ListItem(List=sort.Keys, Index=0, Wrap=True)
smaller = SmallerThan(FirstNumber=pdecon_2.ZComponent, SecondNumber=item_4)  # -> SmallerThan, OrEqualTo
cull = CullPattern(List=surfelem.Points, CullPattern=smaller.OrEqualTo)
cp = ClosestPoint(Point=divide.Points, Cloud=cull)  # -> ClosestPoint, CPIndex, Distance
supp = SupportKaramba3D(PosInd=cp.ClosestPoint, menu=[buttons(on, on, on, off, off, off)])
load = LoadKaramba3D(flatten(loads))
assemble = AssembleModelKaramba3D(Elem=surfelem.Element, Support=supp, Load=load, LimitDistance_m=0.005, CrossSection=crosec, Material=matprops)  # -> Model, Info, Mass_kg, CentreOfGravity, LoadCaseNames
range = Range(Domain=Domain(0, 1), Steps=10)
gradient = Gradient(
    LowerLimit=0,
    UpperLimit=1,
    Parameter=range,
    stops=[0: RGB(234, 38, 0), 0.25: RGB(234, 126, 0), 0.5: RGB(254, 244, 84), 0.75: RGB(173, 203, 249), 1: RGB(75, 107, 169)])
colour = Colour(reverse(gradient))
analyse = AnalyseKaramba3D(Model=assemble.Model)  # -> AnalysedModel, MaximumDisplacement_cm, ResultingForce_kN, ChangeOfElasticEnergy_kNm
num = Number(analyse.MaximumDisplacement_cm)
modelview = ModelViewKaramba3D(Model=analyse.AnalysedModel, Colours=colour)  # -> Model, DeformedMesh, DeformedAxes, DeformedModel, MaximumDeformation
utilization = UtilizationOfElementsKaramba3D(AnalysedModel=analyse.AnalysedModel, mode="Shells")  # -> Model, flatten(Utilization), LoadCaseIndex
shellview = ShellViewKaramba3D(Model=modelview.Model, IndexOfLayer=0)  # -> Model, MeshesOfRenderedShells, LegendColours, LegendTags
bnd = Bounds(Numbers=utilization.Utilization)
panel_5 = Panel(bnd)
dedomain = DeconstructDomain(Domain=bnd)  # -> Start, End
legend = Legend(Colour=shellview.LegendColours, Tags=shellview.LegendTags, LegendType=1)
num_2 = Number(dedomain.End)
goat = Goat(
    fitness=num_2,
    gene=[number_slider_5, number_slider_6, number_slider_7, number_slider_4, number_slider_8, number_slider_9])
panel_7 = Panel(num_2)

# ==== cluster Cluster
G = ClusterInput()
bbox = BoundingBox(Content=G, Plane=PlaneXY(0, 0, 0))  # -> Box, Box_2
area = Area(Geometry=bbox.Box)  # -> Area, Centroid
xz = XZPlane(Origin=area.Centroid)
F = ClusterInput()
rotate = Rotate(Geometry=G, Angle=degrees("180"), Plane=xz)  # -> Geometry, Transform
X = UnitX(Factor=F)
move = Move(Geometry=rotate.Geometry, Motion=X)  # -> Geometry, Transform
group = Group(Objects=flatten([G, move.Geometry]))
bbox_2 = BoundingBox(Content=group, Plane=PlaneXY(0, 0, 0))  # -> Box, Box_2
box = EvaluateBox(Box=bbox_2.Box, UParameter=0.5, VParameter=0.5, WParameter=Slider(1, range=0..1))  # -> Plane, Point, Include
xy = XYPlane(Origin=box.Point)
mirror = Mirror(Geometry=group, Plane=xy)  # -> Geometry, Transform
ungroup = Ungroup(Group=mirror.Geometry)
geo = Geometry(flatten([ungroup, move.Geometry, G]))
geo_2 = ClusterOutput(geo)
