# Grasshopper definition 301_simple_brep_slicer.ghx (Grasshopper 1.0.7)

# create input brep
number_slider = Slider(32.2, range=10..50)
python = GhPythonScript(r1=number_slider, r2=Slider(43.6, range=10..50), r3=Slider(23.4, range=10..50))  # -> out, brep
# ---------- python: Python ----------
import Rhino.Geometry as rg

pt0,pt1,pt2 = rg.Point3d(0,0,0), rg.Point3d(0,0,50), rg.Point3d(0,0,100)
circles = rg.Circle(pt0, r1), rg.Circle(pt1, r2), rg.Circle(pt2, r3)

print(circles[0].Center)

brep = rg.Brep.CreateFromLoft(curves = [c.ToNurbsCurve() for c in circles], 
                    start = rg.Point3d.Unset, 
                    end = rg.Point3d.Unset, 
                    loftType = rg.LoftType.Uniform,
                    closed = False)

print brep
# ---------- end python ----------
number_slider_2 = Slider(1, range=0..1)
# slice brep to create curves
# hint: brep-plane intersection
python_2 = GhPythonScript(brep=python.brep, layer_height=Slider(1, range=0..20))  # -> out, bounding_box, contours; inputs brep: Brep, layer_height: Int32
# ---------- python_2: Python ----------
import Rhino.Geometry as rg
import copy



#Generate planes based on layer height
bounding_box = brep.GetBoundingBox(rg.Plane.WorldXY)
max_corner = bounding_box.Max
min_corner = bounding_box.Min
center = bounding_box.Center

total_height = max_corner.Z - min_corner.Z
no_layers = total_height/layer_height
print(no_layers)

planes = []
for i in range(int(no_layers)):
    contour_point = rg.Point3d(center.X, center.Y, min_corner.Z + i*layer_height)
    plane = rg.Plane(contour_point, rg.Vector3d.ZAxis)
    planes.append(plane)

#Intersect Brep with plane and get curves as output
contours = []
for plane in planes:
    contour = brep.CreateContourCurves(brep, plane)
    contours.append(contour[0])















#intersection = rg.Brep.CreateContourCurves(Brep,planes)
#Intersect Brep with plane and get curves as output
# ---------- end python_2 ----------
# divide curves and save as PrintPoint class objects
panel = Panel(python_2.contours)

divide_interval = Slider(10, range=0..50)
layers = Slider(10, range=0..50)
number_slider_3 = Slider(1.3, range=0..10)
velocity = Slider(15, range=0..50)

# ----
# Printing parameters generator
curve_printpts = GhPythonScript(curves=python_2.contours, divide_interval=divide_interval, velocity=velocity)  # -> pts_curve, pts_curves, way_points, viz_points; inputs curves: list of Curve, velocity: Int32
# ---------- curve_printpts: Python ----------
import Rhino.Geometry as rg
import math as m
from copy import deepcopy

from compas.geometry import Point, Translation, distance_point_point


##################################################################################################################################################

class PrintPoint(object):
    def __init__(self, point, velocity = 10.0, blend = 0.0, toggle = True):
        self.point = point
        self.velocity = velocity
        self.blend = blend
        self.toggle = toggle
    
    def calculate_blend_radius(self, prev_point, next_point, radius):
        dist_prev = distance_point_point(self.point, prev_point.point)
        dist_next = distance_point_point(self.point, next_point.point)
        max_allowed_radius = min(dist_prev / 2 * 0.99, dist_next / 2 * 0.99, radius)
        self.blend = min(radius, max_allowed_radius)






def divide_crv(crv, divide_interval, endInc):
    """
    Function to divide a curve by closest integer multiple of length
    crv : input curve
    divide_interval : desired length of segments
    endInc : if you want to include the end point
    
    returns : list of points and normals"""
    crv_length = crv.GetLength()
    count = int(crv_length/divide_interval)
    params = crv.DivideByCount(count, endInc)
    points = [crv.PointAt(p) for p in params] 
    return points 





##################################################################################################################################################

#divide curve into points
pts_curves = []
for curve in curves:
    pts_curve = divide_crv(curve, divide_interval, True)
    pts_curves.append(pts_curve)



way_points = []
for pt in pts_curves: #go through points on curve and create them for different heights
    for p in pt:
       way_point = PrintPoint(Point(p.X, p.Y, p.Z), velocity)
       way_points.append(way_point)




#Here we insert a safe point in the beginning
safe_dis = 20.0

T = Translation.from_vector([0, 0, safe_dis])
safe_pt = PrintPoint(way_points[0].point.transformed(T))
safe_pt2 =  PrintPoint(way_points[-1].point.transformed(T))
way_points.insert(0,safe_pt)
way_points.append(safe_pt2)

[pt.calculate_blend_radius(prev_point=way_points[i-1], next_point=way_points[i+1], radius=5.0) for i, pt in zip(range(1,len(way_points)-2), way_points[1:-2])]


viz_points = [waypt.point for waypt in way_points]
way_points = [waypt.__dict__ for waypt in way_points]
# ---------- end curve_printpts ----------

panel_2 = Panel(curve_printpts.way_points)
draw = Draw(cg=curve_printpts.viz_points)  # -> rg
#   port cg: The COMPAS geometry or datastructure to be drawn.
#   port rg: The Rhino geometry object.
# ---------- draw: Python ----------
"""
Draws COMPAS geometry in Grasshopper.
"""
from ghpythonlib.componentbase import executingcomponent as component

from compas.artists import Artist


class CompasToRhinoGeometry(component):
    def RunScript(self, cg):
        if not cg:
            return None

        return Artist(cg).draw()
# ---------- end draw ----------
number_slider_4 = Slider(99, range=0..99)
polyline = PolyLine(Vertices=draw, Closed=False)
panel_3 = Panel("C:\Users\akango\Documents\github\MAS-2324\07_PrintingArchitecture\L02_PrintIt\data\out_printpoints.json")
input = ClusterInput()
panel_4 = Panel("-1")
# Bonus: modify points based on parameters saved as class attributes
# example: save layer index as class attribute and use it to modify points
list_item = ListItem(List=curve_printpts.pts_curves, Index=Slider(592, range=0..2422), Wrap=True)
python_3 = GhPythonScript(data=curve_printpts.way_points, file_path=panel_3, save=Button())  # -> out, a; inputs data: list
# ---------- python_3: Python ----------
from compas import json_dump


if save:
    json_dump(data, file_path, pretty=True)
# ---------- end python_3 ----------
