# Grasshopper definition Exploration_1_07222024.ghx (Grasshopper 1.0.8)
# plug-ins: Pufferfish, Anemone, Kangaroo2 Components

rectangle = Rectangle(Plane=PlaneXY(0, 0, 0), XSize=Slider(5, range=0..10), YSize=Slider(10, range=0..10), Radius=0)  # -> Rectangle, Length
area = Area(Geometry=rectangle.Rectangle)  # -> Area, Centroid
division = Division(A=area.Centroid, B=Slider(2, range=0..10))
rectangle_2 = Rectangle(Plane=division, XSize=Slider(1, range=0..10), YSize=Slider(4, range=0..10), Radius=0)  # -> Rectangle, Length
divide_curve = DivideCurve(Curve=rectangle_2.Rectangle, Count=Slider(20, range=0..100), Kinks=False)  # -> Points, Tangents, Parameters
mesh = Mesh(rectangle.Rectangle)
boolean_toggle = BooleanToggle(True)
polyline = PolyLine(Vertices=divide_curve.Points, Closed=boolean_toggle)
explode = Explode(Curve=polyline, Recursive=True)  # -> Segments, Vertices
length = Length(Curve=explode.Segments)
onmesh = OnMesh(Points=divide_curve.Points, Mesh=mesh, Strength=1)
average = Average(Input=length)
number_slider = Slider(1, range=1..10)
number_slider_2 = Slider(1, range=0..10)
loop_start = LoopStart(Repeat=Slider(10, range=0..10), Trigger=Button())  # -> port, Counter, Data
boolean_toggle_2 = BooleanToggle(True)
remap_numbers = RemapNumbers(Value=loop_start.Counter, Source="0 to 10", Target="1 to 5")  # -> Mapped, Clipped
multiplication = Multiplication(A=average, B=remap_numbers.Mapped)
length_line = LengthLine(Line=explode.Segments, Length=multiplication, Strength=number_slider_2)
spherecollide = SphereCollide(Points=divide_curve.Points, Radius=multiplication, Strength=number_slider_2)
stepsolver = StepSolver(
    GoalObjects=[spherecollide, length_line, onmesh],
    Tolerance=0.0001,
    Momentum=boolean_toggle_2,
    Damping=Slider(0.95, range=0..1),
    SubIterations=Slider(100, range=0..100),
    Animate=Toggle(True))  # -> I, V, O
solver = Solver(Reset=Button(), Threshold=1e-15, Tolerance=0.0001, On=boolean_toggle_2)  # -> I, V, O
curve = Curve(loop_start.Data)
polyline_2 = PolyLine(Vertices=stepsolver.V, Closed=boolean_toggle)
rebuild_curve = RebuildCurve(Curve=polyline_2, Count=Slider(200, range=0..1000), Degree=Slider(1, range=0..10), EndTangents=Toggle(True))
merge = Merge(Data1=curve, Data2=rebuild_curve)  # -> flatten(Result)
clean_tree = CleanTree(RemoveNulls=True, RemoveInvalid=True, RemoveEmpty=False, Tree=merge)
number_slider_3 = Slider(10, range=0..10)
loop_end = LoopEnd(port=loop_start.port, Exit=False, Data=clean_tree, TimeOutVal=0, pausedState=False, state="Constant output")
list_length = ListLength(List=loop_end)
panel = Panel(loop_end)
series = Series(Start=0, Step=Slider(2, range=0..10), Count=list_length)
unit_z = UnitZ(Factor=series)
move = Move(Geometry=loop_end, Motion=unit_z)  # -> Geometry, Transform
loft = Loft(Curves=move.Geometry, Options={Adjust=False, Closed=False, LoftEnds=0, LoftSimp=0, LoftType=0, Rebuild=10, Refit=0.01})
fillet = Fillet(Curve=move.Geometry, Parameter=divide_curve.Points, Radius=Slider(1, range=0..10))  # -> Curve, Parameter
curve_2 = Curve(move.Geometry)
custom_preview = CustomPreview(
    Geometry=move.Geometry,
    Material={diffuse=RGB(221, 160, 221), emission=RGB(66, 48, 66), shine=0.5, specular=RGB(255, 255, 255), transparency=0})
