# Grasshopper definition Test 02.gh (Grasshopper 1.0.7)
# plug-ins: Karamba3D, Octopus

number_slider = Slider(-0.08, range=-0.1..0.3)
number_slider_2 = Slider(0.15, range=-0.1..0.3)
number_slider_3 = Slider(0, range=-0.1..0.3)
number_slider_4 = Slider(5, range=0..10)
number_slider_5 = Slider(10, range=0..10)
python = GhPythonScript(number=number_slider_4, move=number_slider_3, point="0.5")  # -> out, a; inputs number: Int32
# ---------- python: Python ----------
a = []
for i in range(number):
    divide = ((1/number)* i)
    if divide == 0 or divide == point:
        a.append(divide)
    elif divide < point and move != 0:
        distance = abs(((0.5-divide)*move)+divide)
        a.append(distance)
    elif divide > point and move != 0:
        distance = abs(((1-divide)*move)-divide)
        a.append(distance)
    else:
         a.append(divide)
a.append(1)
# ---------- end python ----------
python_2 = GhPythonScript(number=number_slider_4, move=number_slider_2, point="0.5")  # -> out, a; inputs number: Int32; same code as python
python_3 = GhPythonScript(number=number_slider_4, move=number_slider, point="0.5")  # -> out, a; inputs number: Int32; same code as python
octopus = Octopus(OctopusData_gene=[number_slider_2, number_slider, number_slider_3], OctopusData_obj=num_2)
dom = ConstructDomain(DomainStart=Slider(0.1, range=0..0.1), DomainEnd=expr("x*-1", 0))
box = DomainBox(Base=PlaneXY(0, 0, 0), X=dom, Y=dom, Z=dom)
crossref = CrossReference(ListA=python_2.a, ListB=python_3.a, ListC=python.a, CrossMode=1)  # -> ListA, ListB, ListC
number_slider_6 = Slider(0.01, range=0..1)
crv = Curve([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])
box_2 = EvaluateBox(Box=box, UParameter=crossref.ListA, VParameter=crossref.ListB, WParameter=crossref.ListC)  # -> Plane, Point, Include
python_4 = PythonScript(x=number_slider_4, y=number_slider_4, z=number_slider_4, pointlist=box_2.Point)  # -> out, simplify(cube); inputs pointlist: list
# ---------- python_4: Python ----------
from ghpythonlib.treehelpers import list_to_tree
import Rhino
import Rhino.Geometry as rg
import scriptcontext as sc

# Convert input values to integers
x = int(x) + 1
y = int(y) + 1
z = int(z) + 1

# Initialize lists
points = []
cubes = []

# Retrieve Point3d from GUID
def get_point_from_guid(guid):
    rh_obj = sc.doc.Objects.Find(guid)
    if rh_obj and isinstance(rh_obj.Geometry, rg.Point):
        return rh_obj.Geometry.Location
    else:
        raise TypeError("GUID does not reference a Point3d object")

count = 0
for k in range(0, z):
    points.append([])
    for j in range(0, y): 
        points[k].append([])
        for i in range(0, x):
            pt_guid = pointlist[count]
            pt = get_point_from_guid(pt_guid)
            points[k][j].append(pt)
            count += 1

# Create boxes from the points
for k in range(0, z-1):
    for j in range(0, y-1): 
        for i in range(0, x-1):
            p0 = points[k][j][i]
            p1 = points[k][j][i+1]
            p2 = points[k][j+1][i+1]
            p3 = points[k][j+1][i]
            p4 = points[k+1][j][i]
            p5 = points[k+1][j][i+1]
            p6 = points[k+1][j+1][i+1]
            p7 = points[k+1][j+1][i]
            
            # Create a box using 8 points
            box = rg.Box(rg.BoundingBox([p0, p1, p2, p3, p4, p5, p6, p7]))
            cubes.append(box)

# Convert the list of boxes to a tree
cube = list_to_tree(cubes)
# ---------- end python_4 ----------
linedim = LineDimension(Line=crv, Text="{0:0.00}", Size=number_slider_6)
Z = UnitZ(Factor=Slider(100, range=0..100))
box_3 = Box(python_4.cube)
number_slider_7 = Slider(0.85, range=0..1)
move = Move(Geometry=box_3, Motion=Z)  # -> Geometry, Transform
move_2 = Move(Geometry=crv, Motion=Z)  # -> Geometry, Transform
preview = CustomPreview(Geometry=move.Geometry, Material=ColourSwatch(SwatchColor=RGB(191, 191, 191)))
linedim_2 = LineDimension(Line=move_2.Geometry, Text="{0:0.00}", Size=number_slider_6)
box_4 = EvaluateBox(Box=box, UParameter=number_slider_7, VParameter=number_slider_7, WParameter=number_slider_7)  # -> Plane, Point, Include
number_slider_8 = Slider(2, range=0..10)
edges = BrepEdges(Brep=move.Geometry)  # -> Naked, Interior, NonManifold
pull = PullPoint(Point=box_4.Point, Geometry=graft(box_3), ClosestOnly=True)  # -> ClosestPoint, flatten(Distance)
python_5 = GhPythonScript(number=number_slider_8, move="0.0", point="0.5")  # -> out, a; inputs number: Int32; same code as python
preview_2 = CustomPreview(Geometry=edges.Interior, Material=ColourSwatch(SwatchColor=RGB(255, 0, 0)))
crossref_2 = CrossReference(ListA=python_5.a, ListB=python_5.a, ListC=python_5.a, CrossMode=1)  # -> ListA, ListB, ListC
multiplication = Multiplication(A=pull.Distance, B="100")
geo = Geometry([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])
geo_2 = Geometry([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])
geo_3 = Geometry([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])
larger = LargerThan(FirstNumber=multiplication, SecondNumber=Slider(0, range=0..2.3))  # -> LargerThan, OrEqualTo
filter = StreamFilter(Gate=Slider(0, range=0..2), Stream0=geo, Stream1=geo_2, Stream2=geo_3)
pipe = Pipe(Curve=filter, Radius=Slider(0.33, range=0..1), Caps=2)
dispatch = Dispatch(List=box_3, DispatchPattern=larger.OrEqualTo)  # -> ListA, ListB
group = Group(Objects=filter)
bbox = BoundingBox(Content=group, Plane=PlaneXY(0, 0, 0), UnionBox=True)  # -> Box, Box_2
box_5 = Box(dispatch.ListB)
box_6 = EvaluateBox(Box=graft(box_5), UParameter=crossref_2.ListA, VParameter=crossref_2.ListB, WParameter=crossref_2.ListC)  # -> Plane, Point, Include
python_6 = PythonScript(x=number_slider_8, y=number_slider_8, z=number_slider_8, pointlist=box_6.Point)  # -> out, simplify(cube); inputs pointlist: list; same code as python_4
morph = BoxMorph(Geometry=group, Reference=bbox.Box, Target=dispatch.ListA)
box_7 = Box(python_6.cube)
morph_2 = BoxMorph(Geometry=group, Reference=bbox.Box, Target=box_7)
ungroup = Ungroup(Group=[morph, morph_2])  # -> flatten(Objects)
line = Line(ungroup)
number_slider_9 = Slider(2, range=0..100)
number_slider_10 = Slider(0.21, range=0..1)
matprops = MaterialPropertiesKaramba3D(
    FamilyOfMaterial="Steel",
    Name="S235",
    YoungsModulus_kN_cm²=number_slider_9,
    InPlaneShearModulus_kN_cm²=expr("x/2", number_slider_9),
    TransverseShearModulus_kN_cm²=expr("x/2", number_slider_9),
    SpecificWeight_kN_m³=Slider(25, range=0..100),
    CoefficientOfThermalExpansion_1=1.2e-05,
    TensileStrength_kN_cm²=Slider(0.005, range=0..0.01),
    CompressiveStrength_kN_cm²=expr("x*-1", Slider(0.06, range=0..1)),
    StrengthHypothesis="MISES",
    mode="Isotrop")
crosec = CrossSectionKaramba3D(
    FamilyNameOfCrossSection="DefaultCroSec",
    Diameter_cm=number_slider_10,
    WallThickness_cm=expr("x/2", number_slider_10),
    mode="Circular Hollow")

# ---- group: Loads (Karamba3D)
loads = LoadsKaramba3D(Vector=Vector(0, 0, -1), LCase="LC0", mode="Gravity")

# ----
lineelem = CreateLinearElementKaramba3D(
    Line=line,
    CrossSection=crosec,
    LimitDistance_m=0.005,
    BucklingLengthY_m=-1,
    BucklingLengthZ_m=-1,
    BucklingLengthLT_m=-1,
    Bending=True,
    ToPolylineMaxAngle=0.03,
    ToPolylineTolerance=0.01,
    ToPolylineMaxEdgeLength=0.25,
    New=True,
    Remove=True,
    mode="LineToBeam")  # -> Element, Points, Info
pt = Point(lineelem.Points)
pdecon = Deconstruct(Point=pt)  # -> XComponent, YComponent, ZComponent
smaller = SmallerThan(FirstNumber=pdecon.ZComponent, SecondNumber=Slider(0.1, range=0..10))  # -> SmallerThan, OrEqualTo
dispatch_2 = Dispatch(List=pt, DispatchPattern=smaller.SmallerThan)  # -> ListA, ListB
cull = CullPattern(List=pt, CullPattern=smaller.SmallerThan)
supp = SupportKaramba3D(PosInd=cull, menu=[buttons(on, on, on, on, on, on)])

# ---- group: Assemble Model (Karamba3D)
assemble = AssembleModelKaramba3D(Elem=lineelem.Element, Support=supp, Load=loads, LimitDistance_m=0.005, Material=matprops)  # -> Model, Info, Mass_kg, CentreOfGravity, LoadCaseNames

# ----
license = LicenseKaramba3D()
num = Number(assemble.Mass_kg)

# ---- group: Analyse (Karamba3D)
analyse = AnalyseKaramba3D(Model=assemble.Model)  # -> AnalysedModel, MaximumDisplacement_cm, ResultingForce_kN, ChangeOfElasticEnergy_kNm

# ----
panel = Panel(analyse.MaximumDisplacement_cm)

# ---- group: Model View (Karamba3D)
modelview = ModelViewKaramba3D(Model=analyse.AnalysedModel)  # -> Model, DeformedMesh, DeformedAxes, DeformedModel, MaximumDeformation

# ----
galapagos = Galapagos(fitness=num_2, gene=[number_slider_3, number_slider, number_slider_2])
num_2 = Number(modelview.MaximumDeformation)
panel_2 = Panel(num_2)
merge = Merge(Data1=num_2, Data2=num)
merge_2 = Merge(Data1="defMax", Data2="Mass")

# ---- group: Beam View (Karamba3D)
beamview = BeamViewKaramba3D(Model=modelview.Model)  # -> Model, MeshesOfRenderedBeams, DeformedBeamAxes, LegendColours, LegendTags

# ----
legend = Legend(Colour=beamview.LegendColours, Tags=beamview.LegendTags, LegendType=1)
