# Grasshopper definition variable_velo_convert_json.ghx (Grasshopper 1.0.7)
# plug-ins: Human, Chromodoris

pln = Plane()
python = GhPythonScript(all_planes=pln)  # -> out, way_frames; inputs all_planes: list of Plane, all_velocities: list
# ---------- python: Python ----------
import Rhino.Geometry as rg
import math
import copy
import ghpythonlib.treehelpers as th
from compas.geometry import Point, Translation, distance_point_point, Frame, Vector


class PrintPoint(object):
    def __init__(self, frame, velocity, toggle, blend = 0.0):
        self.frame = frame
        self.velocity = velocity
        self.blend = blend
        self.toggle = toggle

    def calculate_blend_radius(self, prev_frame, next_frame, radius):
        dist_prev = distance_point_point(self.frame.point, prev_frame.point)
        dist_next = distance_point_point(self.frame.point, next_frame.point)
        max_allowed_radius = min(dist_prev / 2 * 0.99, dist_next / 2 * 0.99, radius)
        self.blend = min(radius, max_allowed_radius)

def remap(val, old_min, old_max, min, max):
    #remap a number from a given range to another range
    return (max - min)*(val - old_min) / (old_max - old_min) + min








### /// convert to frames and flatten lists /// ###
all_frames = [Frame(plane.Origin, plane.XAxis, plane.YAxis) for plane in all_planes]



### /// insert a safe point in the beginning & ending /// ###
safe_dis = 10.0

T = Translation.from_vector([0, 0, safe_dis])
all_frames.insert(0, all_frames[0].transformed(T))
all_frames.append(all_frames[-1].transformed(T))
all_velocities.insert(0 , all_velocities[0])
all_velocities.append(all_velocities[-1])

for i in range(2):
    vector2 = all_frames[-1].point - Point(0,0,0)
    vector2.unitize()
    T2 = Translation.from_vector(vector2*20)
    all_frames.append(all_frames[-1].transformed(T2))
    all_velocities.append(all_velocities[-1])





### /// generate way_frames with necessary data /// ###
way_frames = []
for i, (frame, velocity) in enumerate(zip(all_frames, all_velocities)):
    if  i== 0 or i==len(all_frames)-1 or i==len(all_frames)-2 or i==len(all_frames)-3:
        way_frame = PrintPoint(frame, velocity, blend = 0.0, toggle=False)
        way_frames.append(way_frame)
    else:
        way_frame = PrintPoint(frame, velocity, blend = 0.0, toggle=True)
        way_frames.append(way_frame)

[fr.calculate_blend_radius(prev_frame=way_frames[i-1].frame, next_frame=way_frames[i+1].frame, radius=5.0) for i, fr in zip(range(1,len(way_frames)-2), way_frames[1:-2])]

viz_frames = [waypt.frame for waypt in way_frames]
way_frames = [waypt.__dict__ for waypt in way_frames]
# ---------- end python ----------

# ---- group: Visualization settings
layer_index_start = Slider(0, range=0..1000)
layer_index_end = Slider(114, range=0..200)
pt_index_end = Slider(19, range=0..100)

# ---- group: Visualization settings / true/false to display all/only selected printpoitns
display_all = BooleanToggle(False)

# ---- group: Select parameter to display
list = ValueList({"Velocity": 0, "Wait time": 1, "Blend radius": 2, "Extruder Toggle": 3}, selected="Velocity")

# ----
name = Panel("non_planar_60x240_3grapghs_DoubleCurved")
list_2 = ValueList({"Paul": 0, "Panos": 1, "Sagar": 2}, selected="Panos")

panel = Panel("C:\Users\paul\.00 ETH\github\MAS-2324\07_PrintingArchitecture\L02_PrintIt\data\")
panel_2 = Panel("D:\Papachap\GitHub\MAS-2324\07_PrintingArchitecture\L02_PrintIt\data\")
merge = Merge(Data1=panel, Data2=panel_2)
item = ListItem(List=merge, Index=list_2, Wrap=True)
concat = Concatenate(FragmentA=item, FragmentB=name, FragmentC=".json")
panel_3 = Panel(concat)
python_2 = GhPythonScript(data=python.way_frames, file_path=concat, save=Button())  # -> out, a; inputs data: list
# ---------- python_2: Python ----------
from compas import json_dump


if save:
    json_dump(data, file_path, pretty=True)
# ---------- end python_2 ----------

mpipe = MeshPipe(NumberOfSides=Slider(10, range=0..10), Radius=Slider(0.75, range=0..1), Cap=False)
preview = CustomPreview(Geometry=mpipe, Material=ColourSwatch(SwatchColor=RGB(140, 140, 140)))

python_3 = GhPythonScript(data=python.way_frames)  # -> out, frames, points, velocities, blends, toggles; inputs data: list
# ---------- python_3: Python ----------
#extract data info from dictionary
frames = []
points = []
velocities = []
blends = []
toggles = []


for item in data:
    frame = item["frame"]
    frames.append(frame)
    
    points.append(frame.point)
    
    velocity = item["velocity"]
    velocities.append(velocity)
    
    blend = item["blend"]
    blends.append(blend)
    
    toggle = item["toggle"]
    toggles.append(toggle)
# ---------- end python_3 ----------
draw = Draw(cg=python_3.frames)  # -> rg
#   port cg: The COMPAS geometry or datastructure to be drawn.
#   port rg: The Rhino geometry object.
# ---------- draw: Python ----------
"""
Draws COMPAS geometry in Grasshopper.
"""
from ghpythonlib.componentbase import executingcomponent as component

from compas.artists import Artist


class CompasToRhinoGeometry(component):
    def RunScript(self, cg):
        if not cg:
            return None

        return Artist(cg).draw()
# ---------- end draw ----------
draw_2 = Draw(cg=python_3.points)  # -> rg; same code as draw
python_4 = GhPythonScript(layer_index_start=layer_index_start, layer_index_end=layer_index_end, pt_index_end=pt_index_end, display_all=display_all)  # -> out, geometry, points, frames, layer_heights, up_vectors, mesh_normals, closest_support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; inputs layers: list, layer_index_start: Int32, layer_index_end: Int32, pt_index_end: Int32, display_all: Boolean
# ---------- python_4: Python ----------
"""
Visualizes PrintPoints information of compas_slicer paths.
"""

import compas_slicer_ghpython.visualization as gh_compas_slicer
gh_compas_slicer = reload(gh_compas_slicer)

points = []
frames = []
layer_heights = []
up_vectors = []
mesh_normals = []
closest_support = []

velocities = []
wait_times = []
blend_radiuses = []
extruder_toggles = []

if layer_index_start >= len(layers) - 2:
    layer_index_start = len(layers) -2
   
    
if layer_index_end >= len(layers):
    layer_index_end = len(layers)
    
if layer_index_start > layer_index_end:
    layer_index_start = layer_index_end
    
print('layer_index_start = ' + str(layer_index_start))
print('layer_index_end = ' + str(layer_index_end))
    

if len(layers) > 0:
    # display all
    if display_all:
        for layer in layers:
            for path in layer.paths:
                for ppt in path.ppts:
                    
                    points.append(ppt.pt)
                    frames.append(ppt.frame)
                    layer_heights.append(ppt.layer_height)
                    up_vectors.append(ppt.up_vector)
                    mesh_normals.append(ppt.mesh_normal)
                    closest_support.append(ppt.closest_support_pt)
                    
                    velocities.append(ppt.velocity)
                    wait_times.append(ppt.wait_time)
                    blend_radiuses.append(ppt.blend_radius)
                    extruder_toggles.append(ppt.extruder_toggle)
        
    else:
        # display selection
        for i, layer in enumerate(layers[layer_index_start:layer_index_end]):
            if i < layer_index_end-layer_index_start -1:
                # fully displayed layers
                for path in layer.paths:
                    for ppt in path.ppts:
                        points.append(ppt.pt)
                        frames.append(ppt.frame)
                        layer_heights.append(ppt.layer_height)
                        up_vectors.append(ppt.up_vector)
                        mesh_normals.append(ppt.mesh_normal)
                        closest_support.append(ppt.closest_support_pt)
                        
                        velocities.append(ppt.velocity)
                        wait_times.append(ppt.wait_time)
                        blend_radiuses.append(ppt.blend_radius)
                        extruder_toggles.append(ppt.extruder_toggle)
            else:
                # partly displayed layers (using pt_index_end)
                count = 0
                for path in layer.paths:
                    for ppt in path.ppts:
                        if count < pt_index_end:
                            points.append(ppt.pt)
                            frames.append(ppt.frame)
                            layer_heights.append(ppt.layer_height)
                            up_vectors.append(ppt.up_vector)
                            mesh_normals.append(ppt.mesh_normal)
                            closest_support.append(ppt.closest_support_pt)
                            
                            velocities.append(ppt.velocity)
                            wait_times.append(ppt.wait_time)
                            blend_radiuses.append(ppt.blend_radius)
                            extruder_toggles.append(ppt.extruder_toggle)
                            
                            count += 1
# ---------- end python_4 ----------
panel_4 = Panel(python_4.out)

pln_2 = Plane(draw)

velocities = Number(python_3.velocities)
extruder_toggles = Number(python_3.toggles)
wait_times = Number()
blend_radiuses = Number(python_3.blends)

points = Point(draw_2)
layer_heights = Number(python_4.layer_heights)
up_vectors = Vector(python_4.up_vectors)
mesh_normals = Vector(python_4.mesh_normals)
cpts = Point(python_4.closest_support)
frames = Plane(draw)

pline = PolyLine(Vertices=points, Closed=False)
explode = Explode(Curve=pline, Recursive=True)  # -> Segments, Vertices
len = Length(Curve=explode.Segments)
ma = MassAddition(Input=len)  # -> Result, PartialResults
total_path_length = Panel(ma.Result)
previewlw = CustomPreviewLineweights(Geometry=pline, Shader=ColourSwatch(SwatchColor=RGB(153, 153, 153)), Thickness=Slider(2, range=0..10), Absolute=False)

vdis = VectorDisplay(Anchor=points, Vector=expr("x*5", up_vectors))
filter = StreamFilter(Gate=list, Stream0=velocities, Stream1=wait_times, Stream2=blend_radiuses, Stream3=extruder_toggles)
num = Number(filter)

# ---- group: Visualize parameter with color
bnd = Bounds(Numbers=num)
avr = Average(Input=num)
dedomain = DeconstructDomain(Domain=bnd)  # -> Start, End
average = Panel(avr)
gradient = Gradient(
    LowerLimit=dedomain.Start,
    UpperLimit=dedomain.End,
    Parameter=num,
    stops=[0: RGB(0, 128, 0), 0.5: RGB(255, 255, 0), 1: RGB(255, 0, 0)])
pt = Point(points)
cloud = CloudDisplay(Points=pt, Colours=gradient, Size=Slider(1.24, range=0..10), SpriteType=0)

# ---- group: Visualize parameter with text
tag_offset = Slider(1, range=0..100)
pdecon = Deconstruct(Point=points)  # -> XComponent, YComponent, ZComponent
addition = Addition(A=pdecon.ZComponent, B=tag_offset)
pt_2 = ConstructPoint(XCoordinate=pdecon.XComponent, YCoordinate=pdecon.YComponent, ZCoordinate=addition)
tag = TextTag(Location=pt_2, Text=num, Colour=ColourSwatch(SwatchColor=RGB(50, 130, 186)))

# ----
min = Panel(dedomain.Start)
max = Panel(dedomain.End)
